# Grasshopper definition fabrication_control.ghx (Grasshopper 1.0.7)

bang = Button()
panel = Panel("Unload libraries")
unload = PythonScript(bang=bang)
# ---------- unload: Python ----------
from compas_rhino.utilities.misc import unload_modules

unload_modules("compas")
unload_modules("fabrication_control")
unload_modules("assembly_information_model")
# ---------- end unload ----------

reset_fabrication = Button()

# ----
# FABRICATION PROCESS CONTROL
init = Button()
resume_fabrication = Button()
pause_fabrication = Button()
start_fabrication = Button()
stop_fabrication = Button()
set_tasks = Button()
fabrication = PythonScript(init=init)  # -> out, fabrication
# ---------- fabrication: Python ----------
from scriptcontext import sticky as st
from fabrication_control.fabrication import Fabrication
import time
import Rhino.Geometry as rg
import ghpythonlib.components as ghcomp
import math as m


class FabricationGH(Fabrication):
    
    def perform_task(self, node):
        """ this method controls the execution of one task in a list of the set tasks of the fabrication.
        --> it has to be filled in with your task routines """

        self.log("TASK STARTED: ---->>>>>")
        ok = False
        time.sleep(1.0)
        ok = True
        self.log("----<<<<< TASK FINISHED")
        return True

fabrication = FabricationGH()

st["fabrication"] = fabrication
# ---------- end fabrication ----------
set_fab_params = PythonScript(fabrication=fabrication.fabrication, set_tasks=set_tasks)  # -> out, fabrication; inputs set_tasks: Boolean
# ---------- set_fab_params: Python ----------
from scriptcontext import sticky as st
import Rhino.Geometry as rg


guid = str(ghenv.Component.InstanceGuid)
tasks_set_key = "tasks_set" + guid

if not tasks_set_key in st:
    st[tasks_set_key] = False

if set_tasks == True:
    print "setting tasks"    
    fabrication.clear_tasks()
    fabrication.set_tasks(range(10)) #needs to be revised with aim
    st[tasks_set_key] = True
# ---------- end set_fab_params ----------
fabrication_2 = PythonScript(
    fabrication=set_fab_params.fabrication,
    start=start_fabrication,
    pause=pause_fabrication,
    resume=resume_fabrication,
    stop=stop_fabrication,
    reset=reset_fabrication)  # -> out
# ---------- fabrication_2: Python ----------
from scriptcontext import sticky as st
import time
import ghpythonlib.components as ghcomp
import Rhino.Geometry as rg
import Grasshopper as gh
import math as m



if start:
    #if robot.is_connected(): #and arduino.is_connected():
    print "starting process"
    fabrication.start()

if stop:
    print "stopping process"
    fabrication.stop()

if pause:
    print "pausing process"
    fabrication.pause()

if resume:
    print "resuming process"
    fabrication.resume()
    
if reset:
    print "resuming process"
    fabrication.reset()
# ---------- end fabrication_2 ----------

# ----
# STATE  VIEWER
trigger = Trigger(Interval=100, TimerInterval=100, Target=fabrication_state)
fabrication_state = PythonScript()  # -> out, state, iterations, num_tasks_left, log_messages
# ---------- fabrication_state: Python ----------
from scriptcontext import sticky as st

fabrication = st["fabrication"]

state = "THREAD PAUSED" if fabrication.is_alive() and fabrication.is_paused() else "THREAD RUNNING" if fabrication.is_alive() and fabrication.is_paused() == False else "THREAD STOPPED"
iterations = fabrication.iterations

num_tasks_left = len(fabrication.tasks)
print num_tasks_left
log_messages = fabrication.get_log_messages()
# ---------- end fabrication_state ----------
iterations = Panel(fabrication_state.iterations)
state = Panel(fabrication_state.state)
num_tasks_left = Panel(fabrication_state.num_tasks_left)
log_messages = Panel(fabrication_state.log_messages)
